# Grasshopper definition search_by_shape.ghx (Grasshopper 1.0.7)

# ----
# Input
# 1. Load shape
# 2. Browse similar floorplans
image_index = Slider(1, range=0..19)
import_plan_to_rhino = BooleanToggle(True)
load_shape = Button()
input_polygon = Geometry(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)

# ----
# Open Plans Search by Shape
# Output
selectplan = GhPythonScript(reload=load_shape, plan_idx=image_index, import_plan=import_plan_to_rhino)  # -> out, image_url, polygon, building_name, building_metrics; inputs plan_idx: Int32, import_plan: Boolean
# ---------- selectplan: Python ----------
import urllib2
import Rhino
import Rhino.Geometry as rg
import Rhino.Display as rd
import Rhino.Display.RhinoViewport as rv
import scriptcontext
from scriptcontext import sticky
import tempfile
from ghpythonlib.components import BoundarySurfaces
import os


plans_response = sticky['response']
HERE = ghenv.LocalScope.ghdoc.Path
dir_path = os.path.dirname(HERE)

# Set unit system to centimeters
Rhino.RhinoDoc.AdjustModelUnitSystem(Rhino.RhinoDoc.ActiveDoc,Rhino.UnitSystem.Centimeters, False)


def retrieve_image_url(json, index):
    """
    Get all url's to retrieve floorplan images from the server
    Returns url of input index plan
    """
    if 'image_paths' not in sticky:
        sticky['image_paths'] = [ p['image_path'] for p in json['similar_plan_list'] ]
    return sticky['image_paths'][index]
    
def retrieve_polygon(json, index):
    """
    Get all polygon coordinates from the json response and create a boundary surface
    Returns the polygon of input index
    """
    if 'polylines' not in sticky:
        polygon_coords = [p['points'] for p in json['similar_plan_list'] ]
        polygon_coords = [ map(transform_to_rhino_coords, c)  for c in polygon_coords ]
        polylines = []
        for polygon in polygon_coords:
            polyline = rg.Polyline()
            for pt in polygon:
                polyline.Add(rg.Point3d(pt[0], pt[1], 0))
            polylines.append(polyline)
        sticky['polylines'] = polylines
    polyline = sticky['polylines'][index]
    polygon = BoundarySurfaces(polyline)
    polygon.Scale(0.1)
    return polygon
    
def transform_to_rhino_coords(coordinate):
    """ 
    Flip y coordinate to match Rhino system
    Starting top left as 0, 0
    
    Returns : [ x, y ] 
    """
    return list([coordinate[0], coordinate[1]*-1])
    
def retrieve_building_names(json, index):
    """
    Get all building names from similar buildings
    Returns building name of input index
    """
    if 'names' not in sticky:
        sticky['names'] = [p['name'] for p in json['similar_plan_list'] ]
    return sticky['names'][index]
    
def getTransform(plane):
    """
    Transforms plane by moving it down to match top left coordinate with Rhino 0, 0 (x, y) position
    """
    scale = getScale()
    width, height, mms_pp = scale[0], scale[1], scale[2]

    # move plane down along vector
    plane.Translate(rg.Vector3d(0, -height/mms_pp, 0))
    
def getScale(json=plans_response, index=plan_idx):
    """
    Get scale metrics from all floorplan images
    Returns scale metrics of input index
    """
    if 'scale' not in sticky:
        sticky['scale'] = [ (p['width_mm'], p['height_mm'], p['mms_per_pixel']) for p in json['similar_plan_list'] ]
    return sticky['scale'][index]
    
def getMetrics(json, index):
    """
    Print all metrics from the similar polygon
    """
    if 'metrics' not in sticky:
        sticky['metrics'] = [p['metrics'] for p in json['similar_plan_list'] ]

    metrics = [ key + ": " + value for (key, value) in sticky['metrics'][index].iteritems() ]
    return metrics
    
def import_plan2rhino(url):
    """
    This function loads the floorplan image from the server through the input url.
    And sets the image as a background bitmap in Rhino
    """
    
    # read url
    response = urllib2.urlopen(url)
    output = open(filePath, "wb")
    output.write(response.read())
    output.close()
    
    # Rhino Bitmap
    bitmap = rd.DisplayBitmap.Load(url)
    
    # get active view
    view = scriptcontext.doc.Views.ActiveView
    plane = view.ActiveViewport.ConstructionPlane()
    # transform plane to flip image coordinate system
    getTransform(plane) 
    # load image into Rhino view
    view.ActiveViewport.SetTraceImage(filePath, plane, bitmap.Size.Width, bitmap.Size.Height, True, False)
    view.Redraw()
    

image_url = retrieve_image_url(plans_response, plan_idx)
building_name = retrieve_building_names(plans_response, plan_idx)
building_metrics = getMetrics = getMetrics(plans_response, plan_idx)

filename = 'temp_floorplan.jpeg'
filePath = dir_path + "/" + filename

if import_plan is False:
    scriptcontext.doc.Views.ActiveView.ActiveViewport.ClearTraceImage()
    try:
        os.remove(filePath)
    except OSError, e:
        print(e)
else:  
    import_plan2rhino(image_url)
    polygon = retrieve_polygon(plans_response, plan_idx)
# ---------- end selectplan ----------
searchbyshape = GhPythonScript(shape=input_polygon, reload=load_shape)  # -> out; inputs shape: Polyline, reload: Boolean
# ---------- searchbyshape: Python ----------
import System, os
import httplib, urllib2
import json
import pprint
import Rhino
import Rhino.Geometry as rg
import Rhino.Display as rd
import Rhino.Display.RhinoViewport as rv
import scriptcontext
from scriptcontext import sticky

if reload:
    sticky.clear()
    

def format_polygon(x_coords, y_coords):
    coords = [ {'x' : x, 'y' : y} for x, y in zip(x_coords, y_coords) ]
    return {'polygon' : coords }
    
def getOriginalMetrics(json):
    metrics = json['original_metrics']
    metrics = [ key + ": " + value for (key, value) in metrics.iteritems() ]
    print(metrics)

if shape.IsValid is False:
    print("invalid search shape")

if shape.IsClosed:
    print("valid search shape")
    x_coords = [ x for x in shape.X ]
    y_coords = [ y*-1 for y in shape.Y ] # flip y coordinate to start top left as 0, 0 (image coordinate system)
    polygon = format_polygon(x_coords, y_coords)
    data = json.dumps(polygon)
else:
    print('polygon is not closed')
    
# Query URL
url = ("https://open-plans.herokuapp.com/searchbyshape")

req = urllib2.Request(url, data, headers={'Content-Type': 'application/json'})
try:
    response = urllib2.urlopen(req)
except urllib2.HTTPError, e:
    print(e)

resp = response.read()

# from string to JSON
plans_response = json.loads(resp)

# print input search shape metrics
getOriginalMetrics(plans_response)

# print data structured
pp = pprint.PrettyPrinter(indent=1)
#pp.pprint(projects)

sticky['response'] = plans_response
# ---------- end searchbyshape ----------
input_metrics = Panel(searchbyshape)

building_name = Panel(selectplan.building_name)
polygon = Surface(selectplan.polygon)
image_resource = ImageResource(selectplan.image_url)
output_polygon_metrics = Panel(selectplan.building_metrics)
